# Grasshopper definition Proj1_lasercut_appleHolder.gh (Grasshopper 1.0.7)

number_slider = Slider(2.5, range=0..50)
panel = Panel("5inch is ok")
construct_point = ConstructPoint(XCoordinate=0, YCoordinate=0, ZCoordinate=Slider(2, range=0..50))
construct_point_2 = ConstructPoint(XCoordinate=0, YCoordinate=0, ZCoordinate=number_slider)
multiplication = Multiplication(A=number_slider, B="2")
sphere = Sphere(Base=construct_point_2, Radius=number_slider)
cylinder = Cylinder(Base=construct_point, Radius=number_slider, Length=multiplication)
cap_holes = CapHoles(Brep=cylinder)
solid_difference = SolidDifference(BrepsA=sphere, BrepsB=cap_holes)
deconstruct_brep = DeconstructBrep(Brep=solid_difference)  # -> Faces, Edges, Vertices
cull_index = CullIndex(List=deconstruct_brep.Faces, Indices=1, Wrap=True)
number_slider_2 = Slider(4, range=0..50)
bounding_box = BoundingBox(Content=cull_index, Plane=PlaneXY(0, 0, 0))  # -> Box, Box_2
range = Range(Domain=Domain(0, 1), Steps=number_slider_2)
range_2 = Range(Domain=Domain(0, 1), Steps=number_slider_2)
evaluate_box = EvaluateBox(Box=bounding_box.Box, UParameter=range, VParameter=0.5, WParameter=0.5)  # -> Plane, Point, Include
evaluate_box_2 = EvaluateBox(Box=bounding_box.Box, UParameter=0.5, VParameter=range_2, WParameter=0.5)  # -> Plane, Point, Include
yz_plane = YZPlane(Origin=evaluate_box.Plane)
xz_plane = XZPlane(Origin=evaluate_box_2.Point)
brep_plane = BrepPlane(Brep=cull_index, Plane=xz_plane)  # -> flatten(Curves), Points
brep_plane_2 = BrepPlane(Brep=cull_index, Plane=yz_plane)  # -> flatten(Curves), Points
number_slider_3 = Slider(0.125, range=0..50)
curve_curve = CurveCurve(CurveA=brep_plane_2.Curves, CurveB=graft(brep_plane.Curves))  # -> Points, ParamsA, ParamsB
unit_z = UnitZ(Factor=1)
number_slider_4 = Slider(1, range=0..50)
line_sdl = LineSDL(Start=curve_curve.Points, Direction=unit_z, Length=number_slider_4)
construct_domain = ConstructDomain(DomainStart=number_slider_3, DomainEnd=expr("-x", number_slider_3))
curve_middle = CurveMiddle(Curve=line_sdl)
rectangle = Rectangle(Plane=curve_middle, XSize=construct_domain, YSize=construct_domain, Radius=0)  # -> Rectangle, Length
scale = Scale(Geometry=line_sdl, Center=curve_middle, Factor=Slider(1.81, range=0..10))  # -> Geometry, Transform
sub_curve = SubCurve(BaseCurve=reparameterize(scale.Geometry), Domain="0 to 0.5")
sub_curve_2 = SubCurve(BaseCurve=reparameterize(scale.Geometry), Domain="0.5 to 1")
sweep1 = Sweep1(Rail=sub_curve_2, Sections=rectangle.Rectangle, Miter=1)
sweep1_2 = Sweep1(Rail=sub_curve, Sections=rectangle.Rectangle, Miter=1)
number_slider_5 = Slider(0.01, range=0..50)
panel_2 = Panel("""0
2
5
9""")

unit_y = UnitY(Factor=number_slider_3)
negative = Negative(Value=unit_y)
merge = Merge(Data1=negative, Data2=unit_y)
move = Move(Geometry=graft(brep_plane.Curves), Motion=merge)  # -> Geometry, Transform
loft = Loft(Curves=move.Geometry, Options={Adjust=False, Closed=False, LoftEnds=0, LoftSimp=0, LoftType=0, Rebuild=10, Refit=0.01})
unit_z_2 = UnitZ(Factor=number_slider_4)
extrude = Extrude(Base=loft, Direction=unit_z_2)
fillet_edge = FilletEdge(Shape=extrude, Blend=0, Metric=0, Edges=panel_2, Radii=graft(number_slider_5))

unit_x = UnitX(Factor=number_slider_3)
negative_2 = Negative(Value=unit_x)
merge_2 = Merge(Data1=negative_2, Data2=unit_x)
move_2 = Move(Geometry=graft(brep_plane_2.Curves), Motion=merge_2)  # -> Geometry, Transform
loft_2 = Loft(Curves=move_2.Geometry, Options={Adjust=False, Closed=False, LoftEnds=0, LoftSimp=0, LoftType=0, Rebuild=10, Refit=0.01})
unit_z_3 = UnitZ(Factor=number_slider_4)
extrude_2 = Extrude(Base=loft_2, Direction=unit_z_3)
fillet_edge_2 = FilletEdge(Shape=extrude_2, Blend=0, Metric=0, Edges=panel_2, Radii=graft(number_slider_5))

cap_holes_2 = CapHoles(Brep=sweep1_2)
cap_holes_3 = CapHoles(Brep=sweep1)
solid_difference_2 = SolidDifference(BrepsA=fillet_edge_2, BrepsB=flatten(cap_holes_3))
plane = Plane(yz_plane)
plane_2 = Plane(xz_plane)

list_item = ListItem(List=extrude, Index=0, Wrap=True)
deconstruct_brep_2 = DeconstructBrep(Brep=list_item)  # -> Faces, Edges, Vertices
point_on_curve = PointOnCurve(deconstruct_brep_2.Edges, parameter=0.789)
point_list = PointList(Points=point_on_curve, Size=Slider(0.32, range=0..50))

cull_index_2 = CullIndex(List=plane_2, Indices=[0, -1], Wrap=True)
cull_index_3 = CullIndex(List=plane, Indices=[0, -1], Wrap=True)
solid_difference_3 = SolidDifference(BrepsA=fillet_edge, BrepsB=flatten(cap_holes_2))
panel_3 = Panel(solid_difference_3)
brep_plane_3 = BrepPlane(Brep=solid_difference_2, Plane=graft(cull_index_3))  # -> flatten(Curves), Points
brep_plane_4 = BrepPlane(Brep=solid_difference_3, Plane=graft(cull_index_2))  # -> flatten(Curves), Points
xy_plane = XYPlane(Origin=Point(0, 0, 0))
construct_point_3 = ConstructPoint(XCoordinate=Slider(10, range=0..100), YCoordinate=0, ZCoordinate=0)
rotate = Rotate(Geometry=brep_plane_4.Curves, Angle=degrees("90"), Plane=xy_plane)  # -> Geometry, Transform
merge_3 = Merge(Data1=rotate.Geometry, Data2=brep_plane_3.Curves)  # -> flatten(Result)
rectangular = Rectangular(
    Plane=construct_point_3,
    SizeX=Slider(11, range=0..100),
    SizeY=Slider(3, range=0..10),
    ExtentX=Slider(2, range=0..10),
    ExtentY=Slider(3, range=0..10))  # -> Cells, Points
area = Area(Geometry=merge_3)  # -> Area, Centroid
area_2 = Area(Geometry=rectangular.Cells)  # -> Area, flatten(Centroid)
list_length = ListLength(List=area.Centroid)  # -> expr("x-1", Length)
yz_plane_2 = YZPlane(Origin=area.Centroid)
sub_list = SubList(List=area_2.Centroid, Domain=list_length, Wrap=True)  # -> List, Index
orient = Orient(Geometry=merge_3, Source=yz_plane_2, Target=sub_list.List)  # -> Geometry, Transform
curve = Curve(orient.Geometry)
